# Dynamo graph Dyn tutorial.dyn (Dynamo 2.5.0.7460)

# note: Nested Lists
# 🔹 Tại sao cần Nested Lists trong Dynamo?
# - Giúp quản lý dữ liệu có cấu trúc phức tạp, như danh sách các điểm trong nhiều đường, danh sách các tường trong nhiều cấp, v.v.
# - Hỗ trợ lặp qua từng nhóm dữ liệu một cách hiệu quả.
# - Giúp thao tác với dữ liệu dễ dàng hơn trong các thuật toán thiết kế tham số.
# 🔹 Cách làm việc với Nested Lists trong Dynamo
# - Tạo Nested Lists
# - Dùng List.Create để tạo danh sách chính.
# - Dùng List.AddItemToEnd hoặc List.AddItemToFront để thêm danh sách con vào danh sách chính.
# - Hoặc dùng List.GroupByKey để nhóm các phần tử lại thành danh sách con.
# - Truy cập phần tử trong Nested Lists
# - Dùng List.GetItemAtIndex để lấy danh sách con theo chỉ mục.
# - Dùng List.Flatten để chuyển danh sách lồng nhau thành danh sách phẳng.
# - Duyệt qua Nested Lists
# - Dùng List.Map hoặc List.Combine để áp dụng một hàm lên từng danh sách con.
# - Dùng Lacing (Shortest, Longest, Cross Product) để kiểm soát cách Dynamo lặp qua danh sách.
# 🔹 Ví dụ thực tế trong Revit
# - Lấy danh sách các tường theo từng cấp độ (Level).
# - Nhóm các cột theo từng Grid.
# - Tạo lưới điểm cho các mô hình tham số.

# group: String.Concat
# note: Ví dụ về String.Concat - dùng để kết hợp nhiều string thành một
code_block = CodeBlock { 1..10; }
string_from_object = FromObject(obj=code_block)
string = StringInput("Hello")
string_2 = StringInput("World")
list_create = List.Create(item0=string, item1=string_2)
concat = String.Concat(string0=string_from_object, string1=list_create)

# group: String.Join
# note: Ví dụ về String.Join trong trường hợp  2 chuỗi viết liền thay vào đó có thể sử dụng String.Join
string_3 = StringInput(".")
string_4 = StringInput("Hello")
string_5 = StringInput("World")
# note: Note:
# - Separator phải hợp lệ. Dùng các ký tự tách như ","  "-" ...
# - String phải là danh sách - Không nhận chuỗi đơn lẻ.
# - Số phải chuyển thành chuỗi trước khi đưa vào ( Có thể dùng StringFromObject như bên trên ).
# - Xử lý danh sách lồng nhau - nested lists (Sử dụng List.Flatten trước khi nối).
join = String.Join(separator=string_3, string0=string_4, string1=string_5)

# group: String from Array
# note: String from Array sử dụng để chuyển 1 dánh sách String thành 1 chuỗi String duy nhất
code_block_2 = CodeBlock { 1..10; }
# note: Note:
# - Không tự động thêm dấu phân cách
string_from_array = FromArray(arr=code_block_2)
